# Grasshopper definition perlin_maze.gh (Grasshopper 1.0.7)
# plug-ins: Noise 4D, Parakeet, Shortest Walk in Gh, Kangaroo2 Components, Pufferfish

radius = Slider(35, range=1..50)
u_count = Slider(17, range=1..30)
v_count = Slider(22, range=1..30)
perlin_time = Slider(4.77, range=0..10)
perlin_scale = Slider(6, range=0..10)
maze_seed = Slider(18, range=0..100)
start = Slider(1227, range=0..3000)
radius_of_tube = Slider(1, range=0..10)
point = Point(Point(0, 0, 6.729852585))
ucount = GetNumber(u_count, AtLeast=1, AtMost=1, Maximum=1.797693135e+308, Minimum=-1.797693135e+308)
number_slider = Slider(165, range=0..200)
radius_2 = GetNumber(radius, AtLeast=1, AtMost=1, Maximum=1.797693135e+308, Minimum=-1.797693135e+308)
vcount = GetNumber(v_count, AtLeast=1, AtMost=1, Maximum=1.797693135e+308, Minimum=-1.797693135e+308)
time = GetNumber(perlin_time, AtLeast=1, AtMost=1, Maximum=1.797693135e+308, Minimum=-1.797693135e+308)
scale = GetNumber(perlin_scale, AtLeast=1, AtMost=1, Maximum=1.797693135e+308, Minimum=-1.797693135e+308)
seed = GetNumber(maze_seed, AtLeast=1, AtMost=1, Maximum=1.797693135e+308, Minimum=-1.797693135e+308)
start_2 = GetNumber(start, AtLeast=1, AtMost=10000, Maximum=1.797693135e+308, Minimum=-1.797693135e+308)
tube = GetNumber(radius_of_tube, AtLeast=1, AtMost=1, Maximum=1.797693135e+308, Minimum=-1.797693135e+308)
sun = GetNumber(Slider(6, range=0..10), AtLeast=1, AtMost=1, Maximum=1.797693135e+308, Minimum=-1.797693135e+308, Prompt="sun")
mesh_sphere = MeshSphere(Base=point, Radius=radius_2, UCount=ucount, VCount=vcount)
division = Division(A=scale, B=number_slider)
subtraction = Subtraction(A=u_count, B=number_slider)
number_slider_2 = Slider(100, range=0..100)
absolute = Absolute(Value=subtraction)
deconstruct_mesh = DeconstructMesh(Mesh=mesh_sphere)  # -> Vertices, Faces, Colours, Normals
division_2 = Division(A=absolute, B=number_slider_2)
division_3 = Division(A=radius_2, B=number_slider_2)
perlinnoise = PerlinNoise(Values=deconstruct_mesh.Vertices, Time=time, Scale=division)
multiplication = Multiplication(A=deconstruct_mesh.Normals, B=perlinnoise)
division_4 = Division(A=tube, B=Slider(20, range=0..100))
multiplication_2 = Multiplication(A=Slider(15, range=0..100), B=multiplication)
colour = Colour(deconstruct_mesh.Normals)
addition = Addition(A=division_2, B=division_3, C=division_4)
move = Move(Geometry=deconstruct_mesh.Vertices, Motion=multiplication_2)  # -> Geometry, Transform
construct_mesh = ConstructMesh(Vertices=move.Geometry, Faces=deconstruct_mesh.Faces, Colours=colour)
division_5 = Division(A=addition, B=Slider(2, range=0..10))
maze = Maze(Mesh=construct_mesh, Seed=seed)
join_curves = JoinCurves(Curves=maze, Preserve=False)
explode = Explode(Curve=join_curves, Recursive=True)  # -> flatten(Segments), flatten(Vertices)
curve = Curve(explode.Segments)
boolean_toggle = BooleanToggle(True)
sort_list = SortList(Keys=curve, ValuesValuesA=curve)  # -> Keys, ValuesValuesA
list_item = ListItem(List=sort_list.ValuesValuesA, Index=start_2, Wrap=boolean_toggle)
list_item_2 = ListItem(List=sort_list.ValuesValuesA, Index="1", Wrap=boolean_toggle)
end_points = EndPoints(Curve=list_item)  # -> Start, End
end_points_2 = EndPoints(Curve=list_item_2)  # -> Start, End
line = Line(StartPoint=end_points_2.Start, EndPoint=end_points.End)
shortest_walk = ShortestWalk(Curves=explode.Segments, WantedPath=line)  # -> ShortestWalk, Succession, Direction, Length
curvepoint = PointOnCurve(sort_list.ValuesValuesA, parameter=0.5)
pt = ConstructPoint(XCoordinate=0, YCoordinate=0, ZCoordinate=0)
pull = PullPoint(Point=curvepoint, Geometry=pt, ClosestOnly=True)  # -> ClosestPoint, Distance
cull_duplicates = CullDuplicates(Points=explode.Vertices, Tolerance=0.1, CullMode=3)  # -> Points, Indices, Valence
bnd = Bounds(Numbers=pull.Distance)
remap = RemapNumbers(Value=pull.Distance, Source=bnd, Target=Domain(0, 1))  # -> Mapped, Clipped
explode_2 = Explode(Curve=shortest_walk.ShortestWalk, Recursive=True)  # -> Segments, Vertices
gradient = Gradient(
    LowerLimit=0,
    UpperLimit=1,
    Parameter=remap.Mapped,
    stops=[0.1: RGB(236, 27, 60), 0.2: RGB(210, 0, 118), 0.3: RGB(103, 0, 120), 0.4: RGB(39, 72, 161), 0.5: RGB(1, 192, 229), 0.6: RGB(18, 178, 90), 0.7: RGB(79, 186, 8), 0.8: RGB(220, 237, 32), 0.9: RGB(247, 159, 20), 1: RGB(243, 57, 0)])
curve_closest_point = CurveClosestPoint(Point=cull_duplicates.Points, Curve=shortest_walk.ShortestWalk)  # -> Point, Parameter, flatten(Distance)
list_length = ListLength(List=explode_2.Segments)
curve_2 = Curve(shortest_walk.ShortestWalk)
mesh = Mesh(construct_mesh)
larger_than = LargerThan(FirstNumber="0", SecondNumber=curve_closest_point.Distance)  # -> LargerThan, OrEqualTo
rebuild_curve = RebuildCurve(Curve=curve_2, Count=list_length, Degree=Slider(3, range=0..10), EndTangents=False)
dispatch = Dispatch(List=cull_duplicates.Points, DispatchPattern=larger_than.OrEqualTo)  # -> ListA, ListB
multipipe = MultiPipe(
    Curves=rebuild_curve,
    NodeSize=division_5,
    EndOffset=1,
    StrutSize=Slider(0.412, range=0..2),
    Segment=0,
    KinkAngle=division_5,
    CubeFit=0,
    Caps=Slider(1, range=0..2))
cull_duplicates_2 = CullDuplicates(Points=explode_2.Vertices, Tolerance=0.1, CullMode=3)  # -> Points, Indices, Valence
length = Length(Curve=join_curves)
list_length_2 = ListLength(List=cull_duplicates_2.Points)
list_length_3 = ListLength(List=cull_duplicates_2.Points)
deconstruct_mesh_2 = DeconstructMesh(Mesh=multipipe)  # -> Vertices, Faces, Colours, Normals
integer_division = IntegerDivision(A=list_length_3, B=Slider(1.5, range=0..10))
mass_addition = MassAddition(Input=length)  # -> Result, PartialResults
subtraction_2 = Subtraction(A=list_length_3, B=integer_division)
bnd_2 = Bounds(Numbers=deconstruct_mesh_2.Vertices)
absolute_2 = Absolute(Value=subtraction_2)
remap_2 = RemapNumbers(Value=deconstruct_mesh_2.Vertices, Source=bnd_2, Target=Domain(0, 1))  # -> Mapped, Clipped
addition_2 = Addition(A=Slider(30, range=0..100), B=absolute_2)
random_reduce = RandomReduce(List=cull_duplicates_2.Points, Reduction=addition_2, Seed=seed)
distance = Distance(PointA=point, PointB=random_reduce)
division_6 = Division(A=distance, B=Slider(3, range=0..10))
amplitude = Amplitude(Vector=random_reduce, Amplitude=division_6)
gradient_2 = Gradient(
    LowerLimit=0,
    UpperLimit=1,
    Parameter=remap_2.Mapped,
    stops=[0: RGB(234, 38, 0), 0.25: RGB(234, 126, 0), 0.5: RGB(254, 244, 84), 0.75: RGB(173, 203, 249), 1: RGB(75, 107, 169)])
sphere = Sphere(Base=random_reduce, Radius=Slider(0.75, range=0..1))
scale_2 = Scale(Geometry=mesh, Center=point, Factor=Slider(0.524, range=0..2))  # -> Geometry, Transform
move_2 = Move(Geometry=sphere, Motion=amplitude)  # -> Geometry, Transform
medges = MeshEdges(Mesh=scale_2.Geometry)  # -> NakedEdges, InteriorEdges, NonManifoldEdges
construct_mesh_2 = ConstructMesh(Vertices=deconstruct_mesh_2.Vertices, Faces=deconstruct_mesh_2.Faces, Colours=gradient_2)
area = Area(Geometry=move_2.Geometry)  # -> Area, Centroid
join = JoinCurves(Curves=medges.InteriorEdges, Preserve=False)
construct_domain = ConstructDomain(DomainStart=Slider(0, range=0..100), DomainEnd=Slider(255, range=0..1000))
point_2 = Point(random_reduce)
point_3 = Point(area.Centroid)
distance_2 = Distance(PointA=point, PointB=area.Centroid)
sort_list_2 = SortList(Keys=point_3, ValuesValuesA=point_3)  # -> Keys, ValuesValuesA
sort_list_3 = SortList(Keys=point_2, ValuesValuesA=point_2)  # -> Keys, ValuesValuesA
division_7 = Division(A=distance_2, B=Slider(20, range=0..100))
scale_3 = Scale(Geometry=move_2.Geometry, Center=area.Centroid, Factor=division_7)  # -> flatten(Geometry), Transform
merge = Merge(Data1=sort_list_3.ValuesValuesA, Data2=sort_list_2.ValuesValuesA)
proximity_3d = Proximity3D(Points=merge, Group=Slider(1, range=0..10))  # -> flatten(Links), Topology
join_curves_2 = JoinCurves(Curves=proximity_3d.Links, Preserve=Toggle(False))
mesh_colours = MeshColours(Mesh=scale_3.Geometry, Colours=ColourSwatch(SwatchColor=RGB(58, 186, 163)))
curvepoint_2 = PointOnCurve(join_curves_2, parameter=0.5)
pt_2 = ConstructPoint(XCoordinate=0, YCoordinate=0, ZCoordinate=0)
c_script = CSharpScript(crv=sort_list.ValuesValuesA, color=gradient)  # -> out, A; inputs crv: Curve, color: Color
# ---------- c_script: C# ----------
    var c = color.R + "," + color.G + "," + color.B;
    crv.SetUserString("color", c);
    A = crv;
# ---------- end c_script ----------
pull_2 = PullPoint(Point=curvepoint_2, Geometry=pt_2, ClosestOnly=True)  # -> ClosestPoint, Distance
bnd_3 = Bounds(Numbers=pull_2.Distance)
remap_3 = RemapNumbers(Value=pull_2.Distance, Source=bnd_3, Target=Domain(0, 1))  # -> Mapped, Clipped
entwine = Entwine(Branch00=scale_2.Geometry, Branch01=construct_mesh_2, Branch02=mesh_colours, FlattenInputs=True)
gradient_3 = Gradient(
    LowerLimit=0,
    UpperLimit=1,
    Parameter=remap_3.Mapped,
    stops=[0.1: RGB(236, 27, 60), 0.2: RGB(210, 0, 118), 0.3: RGB(103, 0, 120), 0.4: RGB(39, 72, 161), 0.5: RGB(1, 192, 229), 0.6: RGB(18, 178, 90), 0.7: RGB(79, 186, 8), 0.8: RGB(220, 237, 32), 0.9: RGB(247, 159, 20), 1: RGB(243, 57, 0)])
c_script_2 = CSharpScript(crv=join_curves_2, color=gradient_3)  # -> out, A; inputs crv: Curve, color: Color; same code as c_script
entwine_2 = Entwine(Branch00=c_script_2.A, Branch01=c_script.A, FlattenInputs=True)

# ---- group: RH_OUT:mesh
mesh_2 = Mesh(flatten(entwine))

# ---- group: RH_OUT:edges
curve_3 = Curve(flatten(entwine_2))

# ---- group: RH_OUT:curve
curve_4 = Curve(join)

# ---- group: RH_OUT:len
data = Data(mass_addition.Result)

# ---- group: RH_OUT:length
data_2 = Data(shortest_walk.Length)

# ---- group: RH_OUT:line
curve_5 = Curve(rebuild_curve)
